# Dynamo graph 05_Write-CA-Legend.dyn (Dynamo 2.16.2.5624)

# group: Change Viewport Type
code_block = CodeBlock { "FIXTURE PLAN"; }
code_block_2 = CodeBlock { "no label"; }
python_script = Python(IN[0]=code_block, IN[1]=code_block_2)  # CPython3
# ---------- python_script.python (125 lines) ----------
# Import Revit and Dynamo modules
import clr
clr.AddReference('RevitServices')
from RevitServices.Persistence import DocumentManager
from RevitServices.Transactions import TransactionManager

clr.AddReference('RevitAPI')
from Autodesk.Revit.DB import *

# Inputs
sheet_name = IN[0]  # The name of the sheet to find viewports on
new_type_name = IN[1]  # The new type name to set (e.g., "no label")

# Output list to store results
output_data = []

# Access the current document
doc = DocumentManager.Instance.CurrentDBDocument

try:
    # Find the sheet with the given name
    sheet = None
    sheet_collector = FilteredElementCollector(doc).OfCategory(BuiltInCategory.OST_Sheets).WhereElementIsNotElementType()

    for s in sheet_collector:
        if s.Name == sheet_name:
            sheet = s
            break

    if sheet is None:
        output_data.append(f"No sheet found with the name '{sheet_name}'.")
    else:
        # Get viewports on the sheet
        viewport_ids = sheet.GetAllViewports()

        if len(viewport_ids) == 0:
            output_data.append(f"No viewports found on sheet '{sheet_name}'.")
        else:
            output_data.append(f"Found {len(viewport_ids)} viewports on sheet '{sheet_name}'.")

            # Iterate over the viewport IDs to find the desired viewport containing the legend view
            viewport_to_modify = None
            for vp_id in viewport_ids:
                viewport = doc.GetElement(vp_id)
                view_id = viewport.ViewId
                view = doc.GetElement(view_id)
                
                # Check if this is the legend we want to modify
                if view.Name == "DSP Comp Ref":
                    output_data.append(f"Found Viewport containing the Legend View named '{view.Name}', Viewport ID: {viewport.Id.IntegerValue}")
                    viewport_to_modify = viewport
                    break

            if viewport_to_modify:
                # Collect necessary data before deletion
                bbox = viewport_to_modify.GetBoxCenter()  # Store location of the viewport
                view_id = viewport_to_modify.ViewId  # Store the view ID
                sheet_id = sheet.Id  # Store the sheet ID
                
                # Collect the available viewport type information from all viewports
                viewport_type_dict = {}
                collector = FilteredElementCollector(doc).OfClass(Viewport)

                # Iterate through collected elements to gather viewport types
                for viewport in collector:
                    type_element = doc.GetElement(viewport.GetTypeId())
                    if type_element:
                        type_name = type_element.get_Parameter(BuiltInParameter.SYMBOL_NAME_PARAM).AsString()
                        if type_name and isinstance(type_name, str):
                            type_name_lower = type_name.lower()
                            if type_name_lower not in viewport_type_dict:
                                viewport_type_dict[type_name_lower] = type_element

                # List all collected viewport types for debugging
                collected_types = [key for key in viewport_type_dict.keys()]
                output_data.append(f"Collected viewport types: {collected_types}")

                # Normalize new type name for comparison (case insensitive)
                new_type_name_normalized = new_type_name.lower()

                # Check if the new type name exists in the project
                new_type_element = viewport_type_dict.get(new_type_name_normalized, None)

                if new_type_element is None:
                    output_data.append(f"No viewport type with the name '{new_type_name}' was found in the gathered viewport types.")
                else:
                    output_data.append(f"Viewport type '{new_type_name}' found, ID: {new_type_element.Id}")

                    # Delete the old viewport
                    try:
                        TransactionManager.Instance.EnsureInTransaction(doc)
                        doc.Delete(viewport_to_modify.Id)
                        output_data.append(f"Deleted original Viewport ID {viewport_to_modify.Id}.")
                        TransactionManager.Instance.TransactionTaskDone()  # Complete the deletion transaction
                    except Exception as e:
                        output_data.append(f"Error deleting original viewport ID {viewport_to_modify.Id}: {str(e)}")

                    # Start a new transaction to create the viewport
                    try:
                        TransactionManager.Instance.EnsureInTransaction(doc)

                        # Validate the bounding box center
                        if bbox is None:
                            bbox = XYZ(0, 0, 0)  # Default location if bbox is invalid

                        # Create the new viewport with the desired type
                        new_viewport = Viewport.Create(doc, sheet_id, view_id, bbox)

                        # Set the new type if applicable
                        if new_viewport and new_type_element:
                            new_viewport.ChangeTypeId(new_type_element.Id)
                            output_data.append(f"Re-created viewport with new type '{new_type_name}' successfully.")
                        else:
                            output_data.append(f"Failed to create new viewport or find the appropriate type.")

                    except Exception as e:
                        output_data.append(f"Error re-creating viewport with new type '{new_type_name}': {str(e)}")
                    finally:
                        TransactionManager.Instance.TransactionTaskDone()  # Complete the creation transaction

except Exception as e:
    output_data.append(f"General error accessing data: {str(e)}")

# Output results
OUT = output_data
# ----------------------------------------
select_model_element = DSModelElementSelection()  # 1 picked in the model
watch = Watch(select_model_element)

watch_2 = Watch(python_script)

# group: Identify Viewports and Types
python_script_2 = Python()  # CPython3
# ---------- python_script_2.python (49 lines) ----------
# Import Revit API and necessary libraries
import clr
clr.AddReference('RevitServices')
from RevitServices.Persistence import DocumentManager

clr.AddReference('RevitAPI')
from Autodesk.Revit.DB import *

# Ensure the script doesn't crash if `IN` is missing or Revit is not ready
try:
    # Get the current Revit document
    doc = DocumentManager.Instance.CurrentDBDocument

    # Main logic: Process all viewports
    viewport_ids = []
    viewport_names = []
    viewport_types = []
    view_ids = []

    # Filter to get all Viewports in the document
    collector = FilteredElementCollector(doc).OfClass(Viewport)

    for viewport in collector:
        # Get the name of the view associated with the viewport
        view_id = viewport.ViewId
        view = doc.GetElement(view_id)
        viewport_name = view.Name if view else "Unknown Name"

        # Get the type of the viewport by accessing the Element Type Name directly
        type_element = doc.GetElement(viewport.GetTypeId())
        viewport_type_name = type_element.get_Parameter(BuiltInParameter.SYMBOL_NAME_PARAM).AsString() if type_element else "Unknown Type"

        # Append to the output lists
        viewport_ids.append(viewport.Id.IntegerValue)
        viewport_names.append(viewport_name)
        viewport_types.append(viewport_type_name)
        view_ids.append(view_id.IntegerValue if view else "Unknown View ID")

    # Output results to Dynamo
    OUT = {
        "Viewport IDs": viewport_ids,
        "Viewport Names": viewport_names,
        "Viewport Types": viewport_types,
        "View IDs": view_ids
    }

except Exception as e:
    # Gracefully handle errors
    OUT = f"An error occurred: {e}"
# ----------------------------------------

watch_3 = Watch(python_script_2)
code_block_3 = CodeBlock { "DSP Comp Ref"; }
